# Grasshopper definition 240112_assigment1.gh (Grasshopper 1.0.8)
# plug-ins: Kangaroo2 Components

number_of_anchors_in_height = Slider(2, range=0..6)
height = Slider(47, range=0..100)
boundary_size_x = Slider(47, range=0..100)
boundary_size_y = Slider(32, range=0..100)
number_of_anchors_in_height_2 = GetInteger(number_of_anchors_in_height, AtLeast=1, AtMost=1, Maximum=2147483647, Minimum=-2147483648, TreeAccess=False)
height_2 = GetInteger(height, AtLeast=1, AtMost=1, Maximum=2147483647, Minimum=-2147483648, TreeAccess=False)
boundary_size_x_2 = GetInteger(boundary_size_x, AtLeast=1, AtMost=1, Maximum=2147483647, Minimum=-2147483648, TreeAccess=False)
boundary_size_y_2 = GetInteger(boundary_size_y, AtLeast=1, AtMost=1, Maximum=2147483647, Minimum=-2147483648, TreeAccess=False)
rectangle = Rectangle(Plane=PlaneXY(0, 0, 0), XSize=boundary_size_x_2, YSize=boundary_size_y_2, Radius=0)  # -> Rectangle, Length
pop2d = Populate2D(Region=rectangle.Rectangle, Count=Slider(3, range=0..10), Seed=1)
Z = UnitZ(Factor=height_2)
pline = PolyLine(Vertices=pop2d, Closed=False)
extr = Extrude(Base=pline, Direction=Z)
brep = Brep(extr)
debrep = DeconstructBrep(Brep=brep)  # -> simplify(graft(Faces)), Edges, Vertices
srf = Surface(debrep.Faces)
crv = Curve(srf)
offsets = OffsetOnSrf(Curve=crv, Distance=Slider(0.2, range=0..1), Surface=srf)
srf_2 = Surface(offsets)
crv_2 = Curve(srf_2)
explode = Explode(Curve=crv_2, Recursive=True)  # -> Segments, Vertices
curvepoint = PointOnCurve(explode.Segments, parameter=0.5)
pdecon = Deconstruct(Point=curvepoint)  # -> XComponent, YComponent, ZComponent
bnd = Bounds(Numbers=pdecon.ZComponent)
dedomain = DeconstructDomain(Domain=bnd)  # -> Start, End
mindex = MemberIndex(Set=pdecon.ZComponent, Member=[dedomain.Start, dedomain.End])  # -> simplify(Index), Count
trim = TrimTree(Tree=mindex.Index, Depth=Slider(1, range=0..10))
crv_3 = Curve(explode.Segments)
cull_i = CullIndex(List=simplify(crv_3), Indices=simplify(trim), Wrap=True)
item = ListItem(List=simplify(cull_i), Index="0", Wrap=True)
item_2 = ListItem(List=cull_i, Index="1", Wrap=True)
flip = FlipCurve(Curve=item, Guide=item_2)  # -> Curve, Flag
num = Number(number_of_anchors_in_height_2)
divide = DivideCurve(Curve=flip.Curve, Count=num, Kinks=False)  # -> Points, Tangents, Parameters
divide_2 = DivideCurve(Curve=item_2, Count=num, Kinks=False)  # -> Points, Tangents, Parameters
ln = Line(StartPoint=divide.Points, EndPoint=divide_2.Points)
panel = Panel("""0
-1""")
cull_i_2 = CullIndex(List=ln, Indices=panel, Wrap=True)
srfsplit = SurfaceSplit(Surface=srf_2, Curves=cull_i_2)
qrsettings = QuadRemeshSettings(
    TargetCount=Slider(39, range=0..100),
    AdaptiveSize=0,
    AdaptiveCount=False,
    HardEdges=False,
    SeamEdges=0,
    Symmetry=0,
    GuideCurves=0)
debrep_2 = DeconstructBrep(Brep=flatten(srfsplit))  # -> flatten(Faces), Edges, flatten(Vertices)
qrmesh = QuadRemesh(Geometry=debrep_2.Faces, Settings=qrsettings)
mjoin = MeshJoin(Meshes=qrmesh)
pt = Point(debrep_2.Vertices)
Y = UnitY(Factor=Slider(0.1, range=0..0.1))
edgelengths = EdgeLengths(Mesh=mjoin, LengthFactor=1, Strength=1)
anchor = Anchor(Point=pt, Strength=10000)
smooth = Smooth(M=mjoin, Strength=1)
pressure = Pressure(M=mjoin, Strength=1)
wind = Wind(Mesh=mjoin, WindVector=Y)
show = Show(G=mjoin)
entwine = Entwine(Branch00=show, Branch01=smooth, Branch02=wind, Branch03=edgelengths, Branch04=anchor, FlattenInputs=True)
zombiesolver = ZombieSolver(GoalObjects=entwine, Threshold=1e-10, Tolerance=0.0001, MaxIterations=50000)  # -> I, V, O
mesh = Mesh(zombiesolver.O)
mesh_2 = Mesh(mesh)
context_bake = ContextBake(Content=mesh_2)
